# Grasshopper definition block attempts.gh (Grasshopper 0.9.76)
# plug-ins: EleFront

listblockd = ListBlockDocument()
reflay = ReferenceByLayer(LayerName="gh")
panel = Panel(listblockd)
deblock = DeconstructBlock(Block=reflay)  # -> Name, Plane, Geometry
bbox = BoundingBox(Content=deblock.Geometry, Plane=PlaneXY(0, 0, 0), UnionBox=True)  # -> Box, Box_2
boxprop = BoxProperties(Box=bbox.Box)  # -> Center, Diagonal, Area, Volume, Degeneracy
xy = XYPlane(Origin=boxprop.Center)
project = Project(Geometry=deblock.Geometry, Plane=xy)  # -> Geometry, Transform
edges = BrepEdges(Brep=project.Geometry)  # -> Naked, Interior, NonManifold
end = EndPoints(Curve=[edges.Naked, edges.Interior, edges.NonManifold])  # -> Start, End
hull = ConvexHull(Points=flatten([end.Start, end.End]), Plane=PlaneXY(0, 0, 0))  # -> Hull, HullZ, Indices
