# Grasshopper definition reconstructor.gh (Grasshopper 0.9.76)
# plug-ins: Python Interpreter

whitelisted_furniture = Panel("""New Furniture_Team Table_NT1
New Furniture_Storage Caddy_NS1
Workstatio_3""")

# ---- group: Boundary to layout into
path = FilePath("F:\Research\ben\Shawnee\boundary_points.json")
python = PythonScript(path=path)  # -> out, a
# ---------- python: Python ----------
import json
import rhinoscriptsyntax as rs

print path, "\n"

with open(path) as json_data:
    d = json.load(json_data)

print len(d), d

boundaries = []
for boundary in d:
    verts = []
    for p in boundary:
        p = p[6:-1].split(",")
        p = [c.split(" = ")[1] for c in p]
        verts.append( tuple(p) )
    pl = rs.AddPolyline(verts)
    boundaries.append(pl)

a = boundaries

"""
Point(X = -7010.990, Y = 52553.369, Z = 61785.000)
"""
# ---------- end python ----------
close = Close(C=python.a)
srf = Surface()

# ---- group: point and rotation
path_2 = FilePath("F:\Research\ben\Shawnee\furniture_instance_metadata.json")
python_2 = PythonScript(path=path_2)  # -> out, lines, words, points, rotations, raw
# ---------- python_2: Python ----------
import json
import rhinoscriptsyntax as rs

print path

with open(path) as json_data:
    d = json.load(json_data)
#    print(d)

raw = []
lines = []
words = []
points = []
rotations = []
for el in d:
    raw.append(str(el))
    p = el["Point"]
    start = rs.AddPoint((p["X"],p["Y"],0))
    end   = (p["X"],p["Y"]+1000,0)
    top   = (p["X"],p["Y"],1)
    thisLine = rs.AddLine(start, end)
    thisAxis = rs.VectorCreate(start, top)
    rotation_angle = el["Rotation"]
    thisLine = rs.RotateObject(thisLine, start, rotation_angle, thisAxis)
    lines.append(thisLine)
    
    words.append( el["Type"]["family"] )
    
    points.append(start)
    rotations.append(rotation_angle)
    

"""
[{'Rotation': 0.0,
 'ELID': 2281780,
 'Type': {'family_type': ' Existing Joinery_Materials Library 04', 
          'family': ' Existing Joinery_Materials Library 04'}, 
 'Point': {'Y': 21317.5447, 
           'X': -64091.6631, 
           'Z': 61785.0}},
"""
# ---------- end python_2 ----------
rad = Radians(Degrees=python_2.rotations)
Y = UnitY(Factor=1)
Z = UnitZ(Factor=1)
vrot = Rotate(Vector=Y, Axis=Z, Angle=rad)
line = LineSDL(Start=python_2.points, Direction=vrot, Length=3000)

# ----
number_slider = Slider(320, range=0..400)
item = ListItem(List=line, Index=number_slider, Wrap=True)
item_2 = ListItem(List=python_2.rotations, Index=number_slider, Wrap=True)
item_3 = ListItem(List=python_2.raw, Index=number_slider, Wrap=True)
panel = Panel(item_3)
pipe = Pipe(Curve=item, Radius=1000, Caps=0)
panel_2 = Panel(item_2)

cset = CreateSet(List=python_2.words)  # -> Set, Map

# ---- group: Filtered markers
python_3 = PythonScript(whitelist=whitelisted_furniture, markers=line, names=python_2.words)  # -> out, filtered_markers, filtered_names; inputs whitelist: list, markers: list of GeometryBase, names: list
# ---------- python_3: Python ----------
filtered_markers = []
filtered_names = []
for m, n in zip(markers, names):
    n=n.strip()
#    print m, "|"+n+"|"
    if n in whitelist:
        filtered_markers.append(m)
        filtered_names.append(n)
        print n
#    else:
#        filtered_markers.append(None)
#        filtered_names.append(None)
# ---------- end python_3 ----------
loc = Loc(C=python_3.filtered_markers)
tag = TextTag3D(Location=loc, Text=python_3.filtered_names, Size=Slider(153, range=0..500), Justification=7)

# ----
end = EndPoints(Curve=line)  # -> Start, End
points = PointList(Points=end.End, Size=Slider(215, range=0..1100))
family_types = Panel(cset.Set)

# ==== cluster Close
C = ClusterInput()
end = EndPoints(Curve=C)  # -> Start, End
ln = Line(StartPoint=end.Start, EndPoint=end.End)
join = JoinCurves(Curves=[ln, C], Preserve=False)
C_2 = ClusterOutput(join)

# ==== cluster Loc
C = ClusterInput()
end = EndPoints(Curve=C)  # -> Start, End
xy = XYPlane(Origin=end.Start)
prot = RotatePlane(Plane=xy, Angle=0.5)
P = ClusterOutput(prot)
